# Grasshopper definition rough_cut.gh (Grasshopper 1.0.7)

# ----
# Set cut speed:
cut_speed = Slider(995, range=200..2000)

# ----
# Set Z axis safe offset:
z_safe_mm = Slider(10, range=1..10)

# ----
# Select your tool diameter:
list = ValueList({"1/4''": 6.35, "1/8''": 3.175, "6mm": 6, "8mm": 8}, selected="8mm")

# ----
# Set offset between layers:
offset_mm = Slider(10, range=5..12)

# ----
# Set overlap (suggested 50%):
overlap = Slider(80, range=10..90)

# ----
# Change to save if you want to save:
save_toggle = ValueList({"Save": True, "Don't Save": False}, selected="Don't Save")

# ----
# Rough Cut Program
# Select your design:
# Right click on 'Brep'->Set One Brep
brep = Brep(<brep referenced from the Rhino model>)

program = Program(brep=brep, overlap=overlap, diameter=list, offset=offset_mm, zsafe=z_safe_mm)
# connection line on bowl edge
crv = Curve()

# ==== cluster Program
brep = ClusterInput()  # Input Brep
diameter = ClusterInput()
overlap = ClusterInput()
offset = ClusterInput()  # How many cm to keep
zsafe = ClusterInput()
panel = Panel(brep)

# ----
# Bounding Box
bbox = BoundingBox(Content=brep, Plane=PlaneXY(0, 0, 0))  # -> Box, Box_2
debrep = DeconstructBrep(Brep=bbox.Box)  # -> Faces, Edges, Vertices
bb_y_width = ListItem(List=debrep.Edges, Index=expr("3", 0), Wrap=True)
bb_height = ListItem(List=debrep.Edges, Index=8, Wrap=True)
bb_x_width = ListItem(List=debrep.Edges, Index=2, Wrap=True)
bb_top_plane = ListItem(List=debrep.Faces, Index=5, Wrap=True)

# ----
# Calculate layers amount
min_pt_dis_mm = Slider(2, range=1..5)
len = Length(Curve=bb_height)
python = GhPythonScript(box_length=len, min_pt_dis=min_pt_dis_mm, offset=offset)  # -> a
# ---------- python: Python ----------
"""Provides a scripting component.
    Inputs:
        box_length: Bounding box length
        min_pt_dis: Distance from minimum point
        offset: Offset between each step.
    Output:
        a: Number of steps."""

__author__ = "Yitzchak Vaknin"
__version__ = "2020.03.13"

import rhinoscriptsyntax as rs

# Constants:
DEFAULT_Y_PERCENT = 20

# if min_pt_dis value is greater than box_length
# the min_pt_dis value set to 20 percent of the box_length.  
if min_pt_dis > box_length:
    min_pt_dis = box_length * (DEFAULT_Y_PERCENT / 100)

a = round((box_length - min_pt_dis) / offset)
print(box_length)
# ---------- end python ----------

# ----
# Direction
Z = UnitZ(Factor=offset)
rev = Reverse(Vector=Z)

# ----
# Calculate Z safe
area = Area(Geometry=bb_top_plane)  # -> Area, Centroid
devec = DeconstructVector(Vector=area.Centroid)  # -> XComponent, YComponent, ZComponent
addition = Addition(A=zsafe, B=devec.ZComponent)

arrlinear = LinearArray(Geometry=bb_top_plane, Direction=rev, Count=python)  # -> Geometry, Transform
brep_2 = Brep(brep)

# ----
# Calculate grid parameters
len_2 = Length(Curve=bb_x_width)
len_3 = Length(Curve=bb_y_width)
python_2 = GhPythonScript(diameter=diameter, overlap=overlap, x_box_length=len_2, y_box_length=len_3)  # -> grid_interval, u_div, v_div
# ---------- python_2: Python ----------
"""Provides a scripting component.
    Inputs:
        diameter: millimeter
        overlap: percentage
        x_box_length: bounding box x axis length
        y_box_length: bounding box y axis length
    Output:
        grid_interval: disance between point on grid (cm)
        u_div: divisions in the surfave U direction
        v_div: divisions in the surfave V direction"""

__author__ = "Yitzchak Vaknin"
__version__ = "2020.09.29"

import rhinoscriptsyntax as rs

grid_interval = diameter * (overlap / 100)
u_div = round(x_box_length / grid_interval)
v_div = round(y_box_length / grid_interval)
# ---------- end python_2 ----------
grid = GridStructure(Surface=bb_top_plane, UDivisions=python_2.u_div, VDivisions=python_2.v_div)  # -> StructureLines, StructureNodes

# ----
# Python: extract each layer edges
python_3 = GhPythonScript(brep=brep_2, planes_array=arrlinear.Geometry)  # -> edges, flatten(parts); inputs planes_array: list
# ---------- python_3: Python ----------
__author__ = "Yitzchak Vaknin"
__version__ = "2020.09.29"

import rhinoscriptsyntax as rs
import Grasshopper as gh

def main():
    plane_parts = list()
    plane_edges = list()
    planes = planes_array[1:]
    for i in range(len(planes)):
        intersection_result = rs.BooleanIntersection(brep, planes[i], delete_input=False)
        plane_parts.append(intersection_result)
        plane_edges.append(rs.DuplicateEdgeCurves(intersection_result))
    return plane_edges, plane_parts

def listToTree(nestedList):
    """Convert a nested python iterable to a datatree."""
    dt = gh.DataTree[object]()
    for i,l in enumerate(nestedList):
        dt.AddRange(l,gh.Kernel.Data.GH_Path(i))
    return dt

edges, parts = main()
edges = listToTree(edges)
parts = listToTree(parts)
# ---------- end python_3 ----------
viewer = ParamViewer(python_3.edges)

# ----
# Fit ArrayLinear tree depth
# to python's component output
cull_i = CullIndex(List=arrlinear.Geometry, Indices=0, Wrap=True)  # -> simplify(graft(List))
viewer_2 = ParamViewer(cull_i)
lng = ListLength(List=viewer_2)

recgrid = Rectangular(Plane=PlaneXY(0, 0, 0), SizeX=1, SizeY=2, ExtentX=10, ExtentY=5)  # -> Cells, Points

# ----
# Filter relevent points
python_4 = GhPythonScript(grid=grid.StructureNodes, brep=brep, plane=cull_i)  # -> simplify(a); inputs grid: list
# ---------- python_4: Python ----------
__author__ = "Yitzchak Vaknin"
__version__ = "2020.09.29"

import rhinoscriptsyntax as rs

Z_INDEX = 2

def trim_float(num):
    """Trim float to a number with 3 digits after point."""
    return float(format(num, '.3f'))

def main():
    res = list()
    points = [rs.PointCoordinates(pt) for pt in grid]
    for pt in points:
        prj_plane = rs.ProjectPointToSurface(pt, plane, (0,0,-1))
        prj_brep = rs.ProjectPointToSurface(pt, brep, (0,0,-1))
        if len(prj_brep) == 1 and (trim_float(prj_brep[0][Z_INDEX]) < trim_float(prj_plane[0][Z_INDEX])):
            res.append(prj_plane[0])
    return res

a = main()
# ---------- end python_4 ----------
viewer_3 = ParamViewer(python_4)

# ----
# Safe distance from edges (intervel grid X multiplier)
number_slider = Slider(1, range=1..5)
multiplication = Multiplication(A=python_2.grid_interval, B=number_slider)

# ----
# Remove points that to close to the edges
pull = PullPoint(Point=python_4, Geometry=python_3.edges, ClosestOnly=True)  # -> ClosestPoint, Distance
larger = LargerThan(FirstNumber=pull.Distance, SecondNumber=multiplication)  # -> LargerThan, OrEqualTo
cull = CullPattern(List=python_4, CullPattern=larger.OrEqualTo)

# ----
# Debugger
number_slider_2 = Slider(0, range=0..20)  # disabled
number_slider_3 = Slider(39, range=-400..400)  # disabled
item = ListItem(Index=number_slider_2, Wrap=True)  # disabled
Y = UnitY(Factor=number_slider_3)  # disabled
move = Move(Geometry=item, Motion=Y)  # -> Geometry, Transform; disabled
X = UnitX(Factor=number_slider_3)  # disabled

# ----
# Create path and returns points list.
# Lines apperas only for debug (use list item to navigate in order)
python_5 = GhPythonScript(grid_interval=python_2.grid_interval, points_lst=cull, z_safe=addition, edges=python_3.edges)  # -> flatten(lines), simplify(points), connected_lines, z_safe_lines; inputs points_lst: list, edges: list
# ---------- python_5: Python ----------
"""Provides a scripting component.
    Inputs:
        grid_interval: The distance between 2 points on the grid.
        points_lst: Relevent points
        z_safe: z safe value
    Output:
        points: Points on path
        lines: main lines
        connected_lines: lines between main lines with same z value 
        z_safe_lines: lines connected through z safe"""

__author__ = "Yitzchak Vaknin"
__version__ = "2020.04.21"

import rhinoscriptsyntax as rs
from scriptcontext import sticky
import Grasshopper as gh

# Constants:
 
X_INDEX = 0
Y_INDEX = 1

# Globals:
lines_list = list()
z_safe_lines = list()
connected_lines = list()
points_list = list()
tupels_list = list() # accumulate points as tuples - 1 or 2 points in tuple


def connect_through_z_safe(pt1, pt2):
    temp1 = rs.AddPoint((pt1[0], pt1[1], z_safe))
    points_list.append(temp1)
    z_safe_lines.append(rs.AddInterpCurve([pt1, temp1]))
    temp2 = rs.AddPoint((pt2[0], pt2[1], z_safe))
    points_list.append(temp2)
    z_safe_lines.append(rs.AddInterpCurve([temp1, temp2]))
    z_safe_lines.append(rs.AddInterpCurve([temp2, pt2]))


def connect_lines(tpl1, tpl2, lastToLast):
    pt1 = tpl1[0]
    pt2 = tpl2[0]
    if lastToLast:
        if tpl1[1] != None:
            pt1 = tpl1[1]
        if len(tpl2) == 2:
            pt2 = tpl2[1]
    temp_curve = rs.AddInterpCurve([pt1, pt2])
    res = False
    for crv in edges:
        res = rs.CurveCurveIntersection(temp_curve, crv)
        if res: break
    if not res:
        connected_lines.append(temp_curve)
    else:
        connect_through_z_safe(pt1, pt2)


def append_pts_in_order(lastToLast, cur_tuple):
    if lastToLast:
        points_list.append(cur_tuple[1])
        points_list.append(cur_tuple[0])
        return False
    else:
        points_list.append(cur_tuple[0])
        points_list.append(cur_tuple[1])
        return True

def create_start_and_end_lines(is_start):
    pt1 = rs.PointCoordinates(points_lst[0]) if is_start else rs.PointCoordinates(points_lst[len(points_lst) - 1])
    temp1 = rs.AddPoint((pt1[0], pt1[1], z_safe))
    points_list.append(temp1)
    if is_start:
        z_safe_lines.append(rs.AddInterpCurve([temp1, pt1]))
    else:
        z_safe_lines.append(rs.AddInterpCurve([pt1, temp1]))

def create_lines():
    cur_tuple = [] # flag to now if we need to accumulate the first point
    lastToLast = False
    last_tuple = [None, None] # accumulate last curve points
    if len(points_lst): create_start_and_end_lines(True)
    for i in range(len(points_lst) - 1):
        
        pt1 = rs.PointCoordinates(points_lst[i])
        pt2 = rs.PointCoordinates(points_lst[i+1])
        # copmare disatnce bwtween 2 points:
        if abs(pt1[Y_INDEX] - pt2[Y_INDEX]) <= (grid_interval+0.1):
            if not cur_tuple: 
                cur_tuple.append(pt1)
        else:
            if cur_tuple:
                cur_tuple.append(pt1)
                lines_list.append(rs.AddInterpCurve(cur_tuple))
                if last_tuple[0] != None:
                    connect_lines(last_tuple, cur_tuple, lastToLast)
                lastToLast = append_pts_in_order(lastToLast, cur_tuple)
                last_tuple[0], last_tuple[1] = cur_tuple[0], cur_tuple[1]
                cur_tuple = list()
            else:
                if last_tuple[0] != None:
                    connect_lines(last_tuple, [pt1], lastToLast)
                points_list.append(pt1)
                last_tuple = [pt1, None]
#     last line:
    if cur_tuple:
        cur_tuple.append(points_lst[len(points_lst) - 1])
        lines_list.append(rs.AddInterpCurve(cur_tuple))
        if last_tuple[0] != None:
            connect_lines(last_tuple, cur_tuple, lastToLast)
        lastToLast = append_pts_in_order(lastToLast, cur_tuple)
    else:
        if last_tuple[0] != None:
            connect_lines(last_tuple, [pt1], lastToLast)
        points_list.append(pt1)
    if len(points_lst): create_start_and_end_lines(False)
    return points_list, lines_list, connected_lines, z_safe_lines

points, lines, connected_lines, z_safe_lines = create_lines()
# ---------- end python_5 ----------
z_safe_lines = Curve(python_5.z_safe_lines)
lines = Curve(python_5.lines)
connected_lines = Curve(python_5.connected_lines)
pt = Point(python_5.points)
viewer_4 = ParamViewer(python_5.points)
